# Grasshopper definition Mini-city Generator.gh (Grasshopper 1.0.7)
# plug-ins: DeCodingSpaces, DeCodingSpaces_StreetNetwork_Utilities, Bifocals

street_minimum_distance = Slider(37, range=0..100)
street_min_lenght = Slider(796, range=0..1000)
# Controls the Street Generator
# based on a cusztomized boundary
street_max_lenght = Slider(1000, range=0..1000)
# Controls the Plot Widths
# based on the street centrality values
number_slider = Slider(97, range=0..100)
# Controls the Street Widths
# based on the street centrality values
linearscaling = Slider(18.81, range=0..100)
expscaling = Slider(0, range=0..1)
crv = Curve(<curve referenced from the Rhino model>)

# ---- group: Stret Generator
pt = Point(Point(82.98331092, 828.1593894, 0))
pt_2 = Point(<point referenced from the Rhino model>)
pt_3 = Point(<point referenced from the Rhino model>)
pt_4 = Point(<point referenced from the Rhino model>)
pt_5 = Point(<point referenced from the Rhino model>)
pt_6 = Point(<point referenced from the Rhino model>)
pline = PolyLine(Vertices=[pt, pt_2, pt_3, pt_4, pt_5, pt_6], Closed=Toggle(True))
street_network_generator = StreetNetworkGenerator(
    Boundary=pline,
    IniStreets=crv,
    MinLength=street_min_lenght,
    MaxLength=street_max_lenght,
    MinDist=street_minimum_distance,
    RandomAngle=10,
    MaxArms=4,
    TreeDepth=7,
    ProbabilityToAddArms=1,
    SeedForRandom=-1)
streetnetworks = Geometry(street_network_generator)
len = Length(Curve=streetnetworks)
larger = LargerThan(FirstNumber=len, SecondNumber=0)  # -> LargerThan, OrEqualTo
cull = CullPattern(List=streetnetworks, CullPattern=larger.LargerThan)
network2segments = NetworkToSegments(NetworkGeometry=cull, ConvertCurves=True, ConversionAngle=0.2, Split=True)
network_smooth = NetworkSmooth(Network=network2segments, SnapThreshold=1, SnapToAnchorPointsOnly=False)
cul_de_sac = CulDeSacRemoval(LineNetwork=network_smooth, Iterations=2)

# ---- group: Street Network Analysis
line_segments = Line(cul_de_sac)
city_graph = CityGraph(
    Path=line_segments,
    LengthCoefficient=1,
    AngularCoefficient=0,
    PairwiseShortestPaths=False,
    Radius=0,
    MaskInputString="000000001",
    PathInfoForPoints=False,
    UseGPU=True)  # -> BetweennessCentrality, ClosenessCentrality, Gravity, BetweennessCentralityWeighted, ClosenessCentralityWeighted, BetweennessCentralityNormalized, SupplementaryGeometry, PathsInformation, OutputGeometry
centrality = Number(city_graph.BetweennessCentrality)
log = Logarithm(Value=centrality)
bnd = Bounds(Numbers=log)
remap = RemapNumbers(Value=log, Source=bnd, Target=Domain(0, 1))  # -> Mapped, Clipped
gradient = Gradient(
    LowerLimit=Slider(1, range=0..1),
    UpperLimit=Slider(0.595, range=0..1),
    Parameter=remap.Mapped,
    stops=[0: RGB(234, 38, 0), 0.25: RGB(234, 126, 0), 0.5: RGB(254, 244, 84), 0.75: RGB(173, 203, 249), 1: RGB(75, 107, 169)])
preview = CustomPreview(Geometry=line_segments, Shader=gradient)

# ----
panel = Panel("Building Area")

# ---- group: Building Area / Input Parameters related to street centrality
# Controls the Building Types
# based on the street centrality values
num = Number()
multiplication = Multiplication(A=num, B=3)
round = Round(Number=multiplication)  # -> Nearest, Floor, Ceiling

# ----
pt_7 = Point()
move = Move(Motion=Vector(0, 0, 10))  # -> Geometry, Transform
orient = Orient(Source=PlaneXY(0, 0, 0), Target=PlaneXY(0, 0, 0))  # -> Geometry, Transform
number_slider_2 = Slider(20, range=0..100)  # disabled
min_building_area = Slider(60, range=0..1000)  # disabled
number_slider_3 = Slider(3.5, range=0..10)  # disabled

extract_polygons = PolygonsFromLines(Lines=line_segments, LineValues=city_graph.BetweennessCentrality, MinBlockSize=Slider(7833, range=0..10000))  # -> Polygons, SynchronizedValues
pow = Power(A=extract_polygons.SynchronizedValues, B=expscaling)
multiplication_2 = Multiplication(A=pow, B=linearscaling)
custoffset = CustomOffset(Polygons=extract_polygons.Polygons, OffsetValues=expr("x*-1", multiplication_2))  # -> OffsetedPolygons, Test
sort = SortList(Keys=pow, ValuesA=pow)  # -> Keys, ValuesA
rev = ReverseList(List=sort.Keys)
number_slider_4 = Slider(3, range=0..15)
pcol = PolylineCollapse(Polyline=custoffset.OffsetedPolygons, Tolerance=number_slider_4)  # -> Polyline, Count
simplify = SimplifyCurve(Curve=pcol.Polyline, Tolerance=number_slider_4, AngleTolerance=10)  # -> Curve, Simplified
item = ListItem(List=rev, Index=0, Wrap=True)  # -> flatten(Item)
geo = Geometry(simplify.Curve)
bnd_2 = Bounds(Numbers=item)
Z = UnitZ(Factor=-0.1)
remap_2 = RemapNumbers(Value=item, Source=bnd_2, Target=Domain(0, 1))  # -> Mapped, Clipped

trim = TrimWithRegion(Curve=geo, Region=crv)  # -> Inside, Outside

boundary = BoundarySurfaces(Edges=trim.Outside)
move_2 = Move(Geometry=boundary, Motion=Z)  # -> Geometry, Transform
streetblocks = Curve(simplify(trim.Outside))
preview_2 = CustomPreview(Geometry=move_2.Geometry, Material=ColourSwatch(SwatchColor=RGB(145, 145, 145)))

# ---- group: Parcelling
# Parcelling single parameter
# Parcelling multi parameter
number_slider_5 = Slider(52, range=0..100)
bnd_3 = Bounds(Numbers=item)
geo_2 = Geometry(streetblocks)
dom = ConstructDomain(DomainStart=Slider(100, range=0..100), DomainEnd=number_slider)
remap_3 = RemapNumbers(Value=item, Source=bnd_3, Target=dom)  # -> Mapped, Clipped
custompars = CustomizedParameters(
    ScalingFactor=1,
    Length=10,
    Angle=90,
    NChildren=2,
    TreeDepth=7,
    MinDistance=1,
    MaxRank=4,
    Rank=0,
    ParcelWidth=number_slider_5,
    Density=10,
    Seed=-1)
custompars_2 = CustomizedParameters(
    ScalingFactor=1,
    Length=10,
    Angle=90,
    NChildren=2,
    TreeDepth=7,
    MinDistance=1,
    MaxRank=4,
    Rank=0,
    ParcelWidth=remap_3.Mapped,
    Density=10,
    Seed=-1)
slicing_tree = SlicingTreeStructureForParcels(CustomizsedParameters=custompars, Blocks=geo_2)  # -> simplify(Parcels)
slicing_tree_2 = SlicingTreeStructureForParcels(CustomizsedParameters=custompars_2, Blocks=geo_2)  # -> simplify(Parcels)
geo_3 = Geometry(slicing_tree)
geo_4 = Geometry(slicing_tree_2)
preview_3 = CustomPreview(Geometry=geo_4, Material=ColourSwatch(SwatchColor=RGB(61, 61, 61)))

# ---- group: Parcelling / Filter small parcels
geo_5 = Geometry(geo_4)
area = Area(Geometry=geo_5)  # -> Area, Centroid
larger_2 = LargerThan(FirstNumber=area.Area, SecondNumber=Slider(100, range=0..1000))  # -> LargerThan, OrEqualTo
cull_2 = CullPattern(List=geo_5, CullPattern=larger_2.LargerThan)

# ---- group: Parcelling (continued)
plots = Geometry(cull_2)

# ---- group: Building Area
streetblocks_2 = Curve(streetblocks)
number_slider_6 = Slider(1, range=0..10)
buildable = BuildableArea(Parcels=plots, Blocks=streetblocks_2, RoadSetback=-5, SideSetback=-3, BackSetback=-3, Tolerance=0.785398)
buildings = BuildingGeneration(
    BuildableArea=buildable,
    Parcels=plots,
    Blocks=streetblocks_2,
    BuildingDepth=Slider(10, range=0..100),
    BuildingLength=Slider(69, range=0..100),
    BuildingType=round.Floor,
    FAR=expr("(x+0.1)/2", num),
    FloorHeight=3)  # -> BuildingFootprint, NumberOfFloors, simplify(BuildingHeight), simplify(FAR), GFA; disabled

# ----
larger_3 = LargerThan(FirstNumber=area.Area, SecondNumber=0)  # -> LargerThan, OrEqualTo
vec2pt = Vector2Pt(PointB=area.Centroid, Unitize=False)  # -> Vector, Length
boundary_2 = BoundarySurfaces(Edges=buildings.BuildingFootprint)  # disabled
c_script = CSharpScript(BH=buildings.BuildingHeight, BHMax=number_slider_2)  # -> out, A; inputs BH: Double, BHMax: Double; disabled
# ---------- c_script: C# usings ----------
using System.IO;
using System.Linq;
using System.Data;
using System.Drawing;
using System.Reflection;
using System.Windows.Forms;
using System.Xml;
using System.Xml.Linq;
using System.Runtime.InteropServices;

using Rhino.DocObjects;
using Rhino.Collections;
using GH_IO;
using GH_IO.Serialization;
# ---------- c_script: C# ----------
    if(BH < BHMax)
      A = BH;
    else
      A = BHMax;
# ---------- end c_script ----------
area_2 = Area(Geometry=boundary_2)  # -> Area, Centroid; disabled
larger_4 = LargerThan(FirstNumber=area_2.Area, SecondNumber=min_building_area)  # -> LargerThan, OrEqualTo; disabled
multiplication_3 = Multiplication(A=c_script.A, B=number_slider_3)  # disabled
Z_2 = UnitZ(Factor=multiplication_3)  # disabled
cull_3 = CullPattern(List=boundary_2, CullPattern=larger_4.LargerThan)  # disabled
cull_4 = CullPattern(List=Z_2, CullPattern=larger_4.LargerThan)  # disabled
extr = Extrude(Base=cull_3, Direction=cull_4)  # disabled
geo_6 = Geometry(simplify(extr))  # disabled
buildings_2 = Brep(simplify(cull_3))  # disabled

# ---- group: Visualization
colour_swatch = ColourSwatch(SwatchColor=RGB(0, 0, 0))  # disabled
colour_swatch_2 = ColourSwatch(SwatchColor=RGB(157, 255, 82))  # disabled
preview_2d_buildings = CustomPreview(Geometry=buildings_2, Shader=colour_swatch)  # disabled
preview_3d_buildings = CustomPreview(Geometry=geo_6, Shader=colour_swatch_2)  # disabled
