# Grasshopper definition twistedPavilion.gh (Grasshopper 1.0.7)
# plug-ins: Kangaroo2 Components, Pufferfish

scale = Slider(58.77, range=0..100)
segments_number = Slider(7, range=3..16)
height = Slider(-30, range=-30..20)
rotation = Slider(1.411, range=0..5)
density = Slider(0, range=0..10)
columns_radius = Slider(2, range=0.1..4)
scale_2 = GetNumber(scale, AtLeast=1, AtMost=1, Maximum=1.797693135e+308, Minimum=-1.797693135e+308)
segments_number_2 = GetInteger(segments_number, AtLeast=1, AtMost=1, Maximum=2147483647, Minimum=-2147483648)
height_2 = GetNumber(height, AtLeast=1, AtMost=1, Maximum=1.797693135e+308, Minimum=-1.797693135e+308)
rotation_2 = GetNumber(rotation, AtLeast=1, AtMost=1, Maximum=1.797693135e+308, Minimum=-1.797693135e+308)
density_2 = GetInteger(density, AtLeast=1, AtMost=1, Maximum=2147483647, Minimum=-2147483648)
column_radius = GetNumber(columns_radius, AtLeast=1, AtMost=1, Maximum=1.797693135e+308, Minimum=-1.797693135e+308)

# ----
# Step 01:
# Base Polygon
plane = Plane(PlaneXY(0, 0, 0))
polygon = Polygon(Plane=plane, Radius=scale_2, Segments=segments_number_2, FilletRadius=0)  # -> Polygon, Length
explode = Explode(Curve=polygon.Polygon, Recursive=True)  # -> Segments, Vertices
polygon_center = PolygonCenter(Polyline=polygon.Polygon)  # -> CenterV, CenterE, CenterA

# ----
# Step 02:
# Polygon Division
removeduplicatepts = RemoveDuplicatePts(Points=explode.Vertices, Tolerance=0.01)
line = Line(StartPoint=polygon_center.CenterV, EndPoint=removeduplicatepts)
merge = Merge(Data1=flatten(line), Data2=flatten(explode.Segments))
multiplication = Multiplication(A=segments_number_2, B=2)
python = GhPythonScript(L=merge, V=multiplication)  # -> a; inputs L: list of Line, V: Int32
# ---------- python: Python ----------
import clr
clr.AddReference("Weaverbird.Core")
clr.AddReference("Weaverbird.CommonSdkSupport")

import Weaverbird as wb
import Weaverbird.CommonSupport as wbc
import Rhino as rc
import System as s

L = s.Collections.Generic.List[rc.Geometry.Line](L)

a = wb.WbStatic.WbWeaveBack[s.Array[rc.Geometry.PolylineCurve], wb.Geometry.IPoints.LineCurve](
    wbc.Support.Import(L), V,
    wbc.CommonPolylinesFactory.Instance,
    None, rc.RhinoDoc.ActiveDoc.ModelAbsoluteTolerance)
# ---------- end python ----------
length = Length(Curve=python)
sort_list = SortList(Keys=length, ValuesValuesA=python)  # -> Keys, reverse(ValuesValuesA)
cull_index = CullIndex(List=sort_list.ValuesValuesA, Indices=0, Wrap=True)
polygon_center_2 = PolygonCenter(Polyline=cull_index)  # -> graft(CenterV), CenterE, CenterA
explode_2 = Explode(Curve=cull_index, Recursive=True)  # -> Segments, Vertices
removeduplicatepts_2 = RemoveDuplicatePts(Points=explode_2.Vertices, Tolerance=0.01)  # -> simplify(UniquePoints)
line_2 = Line(StartPoint=polygon_center_2.CenterV, EndPoint=removeduplicatepts_2)
explode_3 = Explode(Curve=cull_index, Recursive=True)  # -> Segments, Vertices
merge_2 = Merge(Data1=flatten(explode_3.Segments), Data2=flatten(line_2))
removeduplicatelines = RemoveDuplicateLines(Lines=merge_2, Tolerance=0.01)
python_2 = GhPythonScript(L=removeduplicatelines, V=multiplication)  # -> a; inputs L: list of Line, V: Int32; same code as python
length_2 = Length(Curve=python_2)
sort_list_2 = SortList(Keys=length_2, ValuesValuesA=python_2)  # -> Keys, reverse(ValuesValuesA)
cull_index_2 = CullIndex(List=sort_list_2.ValuesValuesA, Indices=0, Wrap=True)
graft_tree = GraftTree(Tree=cull_index_2, IncludeEmptyLists=True, IncludeNullItems=True)  # -> simplify(Tree)
explode_4 = Explode(Curve=cull_index_2, Recursive=True)  # -> simplify(Segments), Vertices
explode_5 = Explode(Curve=graft_tree, Recursive=True)  # -> simplify(Segments), Vertices
length_3 = Length(Curve=explode_4.Segments)
length_4 = Length(Curve=explode_5.Segments)
sort_list_3 = SortList(Keys=length_3, ValuesValuesA=explode_4.Segments)  # -> Keys, reverse(ValuesValuesA)
sort_list_4 = SortList(Keys=length_4, ValuesValuesA=explode_5.Segments)  # -> Keys, reverse(ValuesValuesA)
construct_domain = ConstructDomain(DomainStart="0.25", DomainEnd=expr("1-x", "0.25"))
split_list = SplitList(List=sort_list_3.ValuesValuesA, Index="1")  # -> simplify(ListA), simplify(ListB)
split_list_2 = SplitList(List=sort_list_4.ValuesValuesA, Index="1")  # -> simplify(ListA), simplify(ListB)
join_curves = JoinCurves(Curves=split_list.ListB, Preserve=False)  # -> simplify(Curves)
range = Range(Domain=construct_domain, Steps=density_2)
flip_curve = FlipCurve(Curve=split_list.ListA)  # -> Curve, Flag
graft_tree_2 = GraftTree(Tree=cull_index, IncludeEmptyLists=True, IncludeNullItems=True)  # -> simplify(Tree)
flip_curve_2 = FlipCurve(Curve=split_list_2.ListA)  # -> Curve, Flag
join_curves_2 = JoinCurves(Curves=split_list_2.ListB, Preserve=False)  # -> simplify(Curves)
tween_two_curves = TweenTwoCurves(CurveA=flip_curve.Curve, CurveB=join_curves, Factor=range, Refit=0, PointSample=0)  # -> simplify(Tween)
explode_6 = Explode(Curve=graft_tree_2, Recursive=True)  # -> simplify(Segments), Vertices
merge_3 = Merge(Data1=flip_curve_2.Curve, Data2=join_curves_2)
flatten_tree = FlattenTree(Tree=tween_two_curves, Path="{0}")
flatten_tree_2 = FlattenTree(Tree=explode_6.Segments, Path="{0}")
flatten_tree_3 = FlattenTree(Tree=merge_3, Path="{0}")
merge_4 = Merge(Data1=flatten_tree, Data2=flatten_tree_2, Data3=flatten_tree_3)

# ----
# Step 03:
# Columns' Void
negative = Negative(Value=column_radius)
extend_curve = ExtendCurve(Curve=reparameterize(merge_4), Type=0, Start=negative, End=negative)
reparameterize_curve = ReparameterizeCurve(Curve=extend_curve)  # -> Reparameterized, Original
shatter = Shatter(Curve=reparameterize_curve.Reparameterized, Parameters=0.5)  # -> simplify(Segments)
flatten_tree_4 = FlattenTree(Tree=shatter, Path="{0}")

# ----
# Step 04:
# Sorting Curves Branches
end_points = EndPoints(Curve=merge_4)  # -> Start, End
curve_middle = CurveMiddle(Curve=flatten_tree_4)
cull_duplicates = CullDuplicates(Points=flatten([end_points.Start, end_points.End]), Tolerance=0.1, CullMode=1)  # -> Points, Indices, Valence
length_5 = Length(Curve=flatten_tree_4)
bounds = Bounds(Numbers=length_5)
distance = Distance(PointA=curve_middle, PointB=graft(cull_duplicates.Points))
deconstruct_domain = DeconstructDomain(Domain=bounds)  # -> Start, End
larger_than = LargerThan(FirstNumber=distance, SecondNumber=deconstruct_domain.Start)  # -> LargerThan, OrEqualTo
dispatch = Dispatch(List=flatten_tree_4, DispatchPattern=larger_than.LargerThan)  # -> simplify(ListA), simplify(ListB)

# ----
# Step 05:
# Sorting Curves Directions
number_slider = Slider(16, range=0..100)
reb = RebuildCurve(Curve=dispatch.ListB, Degree=3, Count=number_slider, Tangents=False)
point_on_curve = PointOnCurve(reb, parameter=1)
distance_2 = Distance(PointA=point_on_curve, PointB=graft(cull_duplicates.Points))  # -> simplify(Distance)
bounds_2 = Bounds(Numbers=distance_2)
deconstruct_domain_2 = DeconstructDomain(Domain=bounds_2)  # -> Start, End
larger_than_2 = LargerThan(FirstNumber=distance_2, SecondNumber=expr("x*0.4", deconstruct_domain_2.End))  # -> LargerThan, OrEqualTo
dispatch_2 = Dispatch(List=reb, DispatchPattern=larger_than_2.LargerThan)  # -> ListA, ListB
flip_curve_3 = FlipCurve(Curve=dispatch_2.ListA)  # -> Curve, Flag
merge_5 = Merge(Data1=flip_curve_3.Curve, Data2=dispatch_2.ListB)

# ----
# Step 06:
# Curve Height & Rotation
# By Laurent Delrieu
tree_statistics = TreeStatistics(Tree=merge_5)  # -> Paths, Length, Count
repeat_data = RepeatData(Data=simplify(graft(cull_duplicates.Points)), Length=simplify(graft(tree_statistics.Length)))  # -> simplify(Data)
end = EndPoints(Curve=merge_5)  # -> Start, End
cp = ControlPoints(Curve=merge_5)  # -> Points, Weights, Knots
len = Length(Curve=merge_5)
dup = DuplicateData(Data=graft(end.Start), Number=number_slider, Order=True)
dup_2 = DuplicateData(Data=graft(len), Number=number_slider, Order=True)  # -> simplify(Data)
dup_3 = DuplicateData(Data=graft(repeat_data), Number=number_slider, Order=True)  # -> simplify(Data)
dist = Distance(PointA=simplify(dup), PointB=cp.Points)
division = Division(A=simplify(dist), B=simplify(dup_2))
graph = GraphMapper(
    division,
    x0=0,
    x1=1,
    y0=0,
    y1=1,
    A=1,
    B=0,
    container_name="Linear",
    Graph_x0=0.25,
    Graph_x1=0.75,
    Graph_y0=0.25,
    Graph_y1=0.75)
graph_2 = GraphMapper(
    division,
    x0=0,
    x1=1,
    y0=0,
    y1=1,
    container_name="Bezier",
    cpx=[0, 0.9388551712, 0.9370786548, 1],
    cpy=[0, 0, 0.01298701763, 1])
vec = VectorXYZ(XComponent=0, YComponent=0, ZComponent=graph_2)  # -> Vector, Length
scale_3 = Scale(Geometry=vec.Vector, Center=Point(0, 0, 0), Factor=height_2)  # -> Geometry, Transform
multiplication_2 = Multiplication(A=graph, B=rotation_2)
move = Move(Geometry=cp.Points, Motion=scale_3.Geometry)  # -> Geometry, Transform
neg = Negative(Value=multiplication_2)
rotate = Rotate(Geometry=move.Geometry, Angle=neg, Plane=dup_3)  # -> Geometry, Transform
rotate_2 = Rotate(Geometry=move.Geometry, Angle=multiplication_2, Plane=dup_3)  # -> Geometry, Transform
nurbs = NurbsCurve(Vertices=rotate_2.Geometry, Degree=3, Periodic=False)  # -> Curve, Length, Domain
nurbs_2 = NurbsCurve(Vertices=rotate.Geometry, Degree=3, Periodic=False)  # -> Curve, Length, Domain
crv = Curve(flatten([nurbs.Curve, nurbs_2.Curve]))

parameter_pipe_mesh = ParameterPipeMesh(
    Curve=crv,
    Radius=Slider(0.4, range=0..1),
    ParametersU=[0, 0.1, 0.2, 0.3, 0.4, 0.5, 0.6, 0.7, 0.8, 0.9, 1],
    ParametersV=[0, 0.25, 0.5, 0.75, 1],
    Weighted=invert(False),
    Lengths=invert(False),
    Angle=0,
    Rotation=0,
    EndType=0,
    Triangulate=False)
custom_preview = CustomPreview(Geometry=parameter_pipe_mesh, Material=ColourSwatch(SwatchColor=RGB(255, 0, 255)))

# ---- group: RH_OUT:meshes
mesh = Mesh(flatten(parameter_pipe_mesh))
